# Grasshopper definition grasshopper.gh (Grasshopper 1.0.7)
# plug-ins: Firefly.Core, Bifocals

select_serial_port = Slider(4, range=3..5)  # disabled
open_port = BooleanToggle(False)  # disabled
baud_rate = Panel("9600")  # disabled

select_serial_port_2 = Slider(4, range=3..5)  # disabled
open_port_2 = BooleanToggle(False)  # disabled
baud_rate_2 = Panel("9600")  # disabled
trigger = Trigger(Interval=20, TimerInterval=20, Target=serial_read_generic)  # disabled
serial_read_generic = SerialReadGeneric(StartReadingValues=open_port_2, PortNumber=select_serial_port_2)  # -> SerialOutput, StatusMessage; disabled
open_close_port = OpenClosePort(OpenClosePort=open_port_2, PortNumber=select_serial_port_2, BaudRate=baud_rate_2)  # disabled
raw_serial_read = Panel(serial_read_generic.SerialOutput)  # disabled
status_connection = Panel(open_close_port)  # disabled
seperator = Panel("|")  # disabled
text_split = TextSplit(Text=raw_serial_read, Separators=seperator)  # disabled
panel = Panel(text_split)  # disabled

# ---- group: Selecteer Poort - Open Poort
select_serial_port_3 = Slider(5, range=3..5)
open_port_3 = BooleanToggle(True)

# ----
trigger_2 = Trigger(Interval=20, TimerInterval=20, Target=serial_read_generic_2)  # disabled

offset_naar_binnen = Slider(14, range=0..20)  # disabled
countour_lampsegment = Curve(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)  # disabled
neg = Negative(Value=offset_naar_binnen)  # disabled
offset = OffsetCurve(Curve=countour_lampsegment, Distance=neg, Corners=1)  # disabled

serial_read_generic_2 = SerialReadGeneric(StartReadingValues=open_port, PortNumber=select_serial_port)  # -> SerialOutput, StatusMessage; disabled
open_close_port_2 = OpenClosePort(OpenClosePort=open_port, PortNumber=select_serial_port, BaudRate=baud_rate)  # disabled

# ---- group: Orientatie Streepje
number_slider = Slider(6, range=0..10)  # disabled
number_slider_2 = Slider(6, range=0..10)  # disabled
vec = VectorXYZ(XComponent=number_slider_2, YComponent=number_slider, ZComponent=0)  # -> Vector, Length; disabled

# ----
countour_lampsegment_2 = Curve(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)  # disabled
offset_naar_binnen_2 = Slider(14, range=0..20)  # disabled
neg_2 = Negative(Value=offset_naar_binnen_2)  # disabled
offset_2 = OffsetCurve(Curve=countour_lampsegment_2, Distance=neg_2, Corners=1)  # disabled

baud_rate_3 = Panel("9600")
lengte_streepje = Slider(5, range=2..10)  # disabled
trigger_3 = Trigger(Interval=20, TimerInterval=20, Target=serial_read_generic_3)
raw_serial_read_2 = Panel(serial_read_generic_2.SerialOutput)  # disabled
status_connection_2 = Panel(open_close_port_2)  # disabled
serial_read_generic_3 = SerialReadGeneric(StartReadingValues=open_port_3, PortNumber=select_serial_port_3)  # -> SerialOutput, StatusMessage
seperator_2 = Panel("|")  # disabled
open_close_port_3 = OpenClosePort(OpenClosePort=open_port_3, PortNumber=select_serial_port_3, BaudRate=baud_rate_3)
aantal_punten = Slider(41, range=20..100)  # disabled
rotatie_streepje = Slider(135, range=0..350)  # disabled
panel_2 = Panel("0,0,0")  # disabled
aantal_punten_2 = Slider(20, range=20..100)  # disabled
text_split_2 = TextSplit(Text=raw_serial_read_2, Separators=seperator_2)  # disabled
raw_serial_read_3 = Panel(serial_read_generic_3.SerialOutput)
status_connection_3 = Panel(open_close_port_3)
seperator_3 = Panel("|")
X = UnitX(Factor=1)  # disabled
Z = UnitZ(Factor=1)  # disabled
pop2d = Populate2D(Region=offset, Count=aantal_punten, Seed=1)  # disabled
measurements = ListItem(List=panel, Index=0, Wrap=True)  # -> Item, Item1, Item2, Item3, Item4; disabled
rad = Radians(Degrees=measurements.Item1)  # disabled
ln = Line(StartPoint="0,0,0", EndPoint="0,5,0")
polygon = Polygon(Plane=PlaneXY(0, 0, 0), Radius=3, Segments=Slider(3, range=3..6), FilletRadius=0)  # -> Polygon, Length
lengte_streepje_2 = Slider(5, range=2..10)  # disabled
rectangle = Rectangle(Plane=PlaneXY(0, 0, 0), XSize=Domain(-1, 1), YSize=Domain(-2, 2), Radius=0)  # -> Rectangle, Length
panel_3 = Panel(text_split_2)  # disabled
cirkel_radius = Slider(3, range=1..10)  # disabled
vrot = Rotate(Vector=X, Axis=Z, Angle=rad)  # disabled
cir = Circle(Plane=PlaneXY(0, 0, 0), Radius=1)
streepje = Curve(ln)
pop2d_2 = Populate2D(Region=offset_2, Count=measurements.Item4, Seed=1)  # disabled
rechthoek = Curve(rectangle.Rectangle)
text_split_3 = TextSplit(Text=raw_serial_read_3, Separators=seperator_3)
rectangle_2 = Rectangle(Plane=pop2d, XSize=Domain(-1, 1), YSize=Domain(-2, 2), Radius=0)  # -> Rectangle, Length; disabled
cirkel = Curve(cir)
line = LineSDL(Start=pop2d, Direction=vec.Vector, Length=lengte_streepje)  # disabled
cirkel_radius_2 = Slider(3, range=1..10)  # disabled
cir_2 = Circle(Plane=pop2d, Radius=cirkel_radius)  # disabled
# GATE vervangen door een actuator die 0/1/2 kan leveren als waarde?
number_slider_3 = Slider(2, range=0..2)  # disabled
rectangle_3 = Rectangle(Plane=pop2d_2, XSize=Domain(-1, 1), YSize=Domain(-2, 2), Radius=0)  # -> Rectangle, Length; disabled
line_2 = LineSDL(Start=pop2d_2, Direction=vrot, Length=measurements.Item)  # disabled
rechthoek_2 = Curve(rectangle_2.Rectangle)  # disabled
streepje_2 = Curve(line)  # disabled
cirkel_2 = Curve(cir_2)  # disabled
measurements_2 = ListItem(List=panel_3, Index=0, Wrap=True)  # -> Item, Item1, Item2, Item3, Item4; disabled
cir_3 = Circle(Plane=pop2d_2, Radius=measurements.Item2)  # disabled
panel_4 = Panel(text_split_3)
# Guesture Y Axis (+2)
# Left - Right
# 0-1-2
number_slider_4 = Slider(1, range=0..2)
# GATE vervangen door een actuator die 0/1/2 kan leveren als waarde?
number_slider_5 = Slider(0, range=0..2)  # disabled
rechthoek_3 = Curve(rectangle_3.Rectangle)  # disabled
streepje_3 = Curve(line_2)  # disabled
cirkel_3 = Curve(cir_3)  # disabled
filter = StreamFilter(Gate=number_slider_3, Stream0=streepje_2, Stream1=rechthoek_2, Stream2=cirkel_2)  # disabled
polygon_2 = Polygon(Plane=PlaneXY(0, 0, 0), Radius=measurements_2.Item, Segments=measurements_2.Item1, FilletRadius=0)  # -> Polygon, Length; disabled

offset_naar_binnen_3 = Slider(14, range=0..20)
countour_lampsegment_3 = Curve(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)
neg_3 = Negative(Value=offset_naar_binnen_3)
offset_3 = OffsetCurve(Curve=countour_lampsegment_3, Distance=neg_3, Corners=1)

item = ListItem(List=panel_4, Index=0, Wrap=True)  # -> Item, Item1, Item2, Item3, Item4
filter_2 = StreamFilter(Gate=item.Item3, Stream0=polygon.Polygon, Stream1=rechthoek, Stream2=cirkel)
boundary = BoundarySurfaces(Edges=filter_2)
rotate = Rotate(Geometry=polygon_2.Polygon, Angle=measurements_2.Item2, Plane=PlaneXY(0, 0, 0))  # -> Geometry, Transform; disabled
unit_z = UnitZ(Factor=measurements_2.Item4)  # disabled
series = Series(Start=0, Step=1, Count=measurements_2.Item3)  # disabled
filter_3 = StreamFilter(Gate=measurements.Item3, Stream0=streepje_3, Stream1=rechthoek_3, Stream2=cirkel_3)  # disabled
number_slider_6 = Slider(20, range=0..20)
panel_5 = Panel("""thumb x
1 - 20""")
extrude = Extrude(Base=rotate.Geometry, Direction=unit_z)  # disabled
unit_x = UnitX(Factor=series)  # disabled
panel_6 = Panel("""guesture X axis
0,00 - 1,00""")
number_slider_7 = Slider(1, range=0..1)
move = Move(Geometry=extrude, Motion=unit_x)  # -> Geometry, Transform; disabled
pop2d_3 = Populate2D(Region=offset_3, Count=item.Item, Seed=item.Item2)
move_2 = Move(Geometry=filter_2, Motion=pop2d_3)  # -> Geometry, Transform
# Distance Jedi (+4)
# min 0,01 tot 2,00
number_slider_8 = Slider(2, range=0.01..2)
area = Area(Geometry=move_2.Geometry)  # -> Area, Centroid
scale = Scale(Geometry=move_2.Geometry, Center=area.Centroid, Factor=item.Item4)  # -> Geometry, Transform
# thumb Y
# 0 - 90
# increments van 10°?
number_slider_9 = Slider(23, range=0..90)
rad_2 = Radians(Degrees=item.Item1)
rotate_2 = Rotate(Geometry=scale.Geometry, Angle=rad_2, Plane=area.Centroid)  # -> Geometry, Transform
series_2 = Series(Start=0, Step=Slider(80, range=0..100), Count="5")
geo = Geometry(flatten([rotate_2.Geometry, countour_lampsegment_3]))
X_2 = UnitX(Factor=series_2)
group = Group(Objects=geo)

# ---- group: BAKE IT
move_3 = Move(Geometry=group, Motion=X_2)  # -> Geometry, Transform
