# Grasshopper definition GH_TestscriptArduino_YC.gh (Grasshopper 1.0.7)
# plug-ins: Firefly.Core, Bifocals

select_serial_port = Slider(4, range=3..5)  # disabled
open_port = BooleanToggle(False)  # disabled
baud_rate = Panel("9600")  # disabled

select_serial_port_2 = Slider(4, range=3..5)
open_port_2 = BooleanToggle(False)
baud_rate_2 = Panel("9600")
trigger = Trigger(Interval=20, TimerInterval=20, Target=serial_read_generic)
serial_read_generic = SerialReadGeneric(StartReadingValues=open_port_2, PortNumber=select_serial_port_2)  # -> SerialOutput, StatusMessage
open_close_port = OpenClosePort(OpenClosePort=open_port_2, PortNumber=select_serial_port_2, BaudRate=baud_rate_2)
raw_serial_read = Panel(serial_read_generic.SerialOutput)
status_connection = Panel(open_close_port)
seperator = Panel("|")
text_split = TextSplit(Text=raw_serial_read, Separators=seperator)
panel = Panel(text_split)

trigger_2 = Trigger(Interval=20, TimerInterval=20, Target=serial_read_generic_2)  # disabled

offset_naar_binnen = Slider(14, range=0..20)  # disabled
countour_lampsegment = Curve(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)  # disabled
neg = Negative(Value=offset_naar_binnen)  # disabled
offset = OffsetCurve(Curve=countour_lampsegment, Distance=neg, Corners=1)  # disabled

serial_read_generic_2 = SerialReadGeneric(StartReadingValues=open_port, PortNumber=select_serial_port)  # -> SerialOutput, StatusMessage; disabled
open_close_port_2 = OpenClosePort(OpenClosePort=open_port, PortNumber=select_serial_port, BaudRate=baud_rate)  # disabled

# ---- group: Orientatie Streepje
number_slider = Slider(6, range=0..10)  # disabled
number_slider_2 = Slider(6, range=0..10)  # disabled
vec = VectorXYZ(XComponent=number_slider_2, YComponent=number_slider, ZComponent=0)  # -> Vector, Length; disabled

# ----
offset_naar_binnen_2 = Slider(14, range=0..20)
countour_lampsegment_2 = Curve(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)
neg_2 = Negative(Value=offset_naar_binnen_2)
offset_2 = OffsetCurve(Curve=countour_lampsegment_2, Distance=neg_2, Corners=1)

lengte_streepje = Slider(5, range=2..10)  # disabled
raw_serial_read_2 = Panel(serial_read_generic_2.SerialOutput)  # disabled
status_connection_2 = Panel(open_close_port_2)  # disabled
seperator_2 = Panel("|")  # disabled
aantal_punten = Slider(41, range=20..100)  # disabled
rotatie_streepje = Slider(135, range=0..350)
panel_2 = Panel("0,0,0")  # disabled
aantal_punten_2 = Slider(20, range=20..100)
text_split_2 = TextSplit(Text=raw_serial_read_2, Separators=seperator_2)  # disabled
X = UnitX(Factor=1)
Z = UnitZ(Factor=1)
pop2d = Populate2D(Region=offset, Count=aantal_punten, Seed=1)  # disabled
measurements = ListItem(List=panel, Index=0, Wrap=True)  # -> Item, Item1, Item2, Item3, Item4
rad = Radians(Degrees=measurements.Item1)
lengte_streepje_2 = Slider(5, range=2..10)
panel_3 = Panel(text_split_2)  # disabled
cirkel_radius = Slider(3, range=1..10)  # disabled
vrot = Rotate(Vector=X, Axis=Z, Angle=rad)
pop2d_2 = Populate2D(Region=offset_2, Count=measurements.Item4, Seed=1)
rectangle = Rectangle(Plane=pop2d, XSize=Domain(-1, 1), YSize=Domain(-2, 2), Radius=0)  # -> Rectangle, Length; disabled
line = LineSDL(Start=pop2d, Direction=vec.Vector, Length=lengte_streepje)  # disabled
cirkel_radius_2 = Slider(3, range=1..10)
cir = Circle(Plane=pop2d, Radius=cirkel_radius)  # disabled
# GATE vervangen door een actuator die 0/1/2 kan leveren als waarde?
number_slider_3 = Slider(2, range=0..2)  # disabled
rectangle_2 = Rectangle(Plane=pop2d_2, XSize=Domain(-1, 1), YSize=Domain(-2, 2), Radius=0)  # -> Rectangle, Length
line_2 = LineSDL(Start=pop2d_2, Direction=vrot, Length=measurements.Item)
rechthoek = Curve(rectangle.Rectangle)  # disabled
streepje = Curve(line)  # disabled
cirkel = Curve(cir)  # disabled
measurements_2 = ListItem(List=panel_3, Index=0, Wrap=True)  # -> Item, Item1, Item2, Item3, Item4; disabled
cir_2 = Circle(Plane=pop2d_2, Radius=measurements.Item2)
# GATE vervangen door een actuator die 0/1/2 kan leveren als waarde?
number_slider_4 = Slider(0, range=0..2)
rechthoek_2 = Curve(rectangle_2.Rectangle)
streepje_2 = Curve(line_2)
cirkel_2 = Curve(cir_2)
filter = StreamFilter(Gate=number_slider_3, Stream0=streepje, Stream1=rechthoek, Stream2=cirkel)  # disabled
polygon = Polygon(Plane=PlaneXY(0, 0, 0), Radius=measurements_2.Item, Segments=measurements_2.Item1, FilletRadius=0)  # -> Polygon, Length; disabled
rotate = Rotate(Geometry=polygon.Polygon, Angle=measurements_2.Item2, Plane=PlaneXY(0, 0, 0))  # -> Geometry, Transform; disabled
unit_z = UnitZ(Factor=measurements_2.Item4)  # disabled
series = Series(Start=0, Step=1, Count=measurements_2.Item3)  # disabled
filter_2 = StreamFilter(Gate=measurements.Item3, Stream0=streepje_2, Stream1=rechthoek_2, Stream2=cirkel_2)
extrude = Extrude(Base=rotate.Geometry, Direction=unit_z)  # disabled
unit_x = UnitX(Factor=series)  # disabled
move = Move(Geometry=extrude, Motion=unit_x)  # -> Geometry, Transform; disabled
