# Grasshopper definition grasshopper_testscript.gh (Grasshopper 1.0.7)
# plug-ins: Firefly.Core

select_serial_port = Slider(4, range=3..5)
open_port = BooleanToggle(False)
baud_rate = Panel("9600")
trigger = Trigger(Interval=20, TimerInterval=20, Target=serial_read_generic)
serial_read_generic = SerialReadGeneric(StartReadingValues=open_port, PortNumber=select_serial_port)  # -> SerialOutput, StatusMessage
open_close_port = OpenClosePort(OpenClosePort=open_port, PortNumber=select_serial_port, BaudRate=baud_rate)
raw_serial_read = Panel(serial_read_generic.SerialOutput)
status_connection = Panel(open_close_port)
seperator = Panel("|")
text_split = TextSplit(Text=raw_serial_read, Separators=seperator)
panel = Panel(text_split)
measurements = ListItem(List=panel, Index=0, Wrap=True)  # -> Item, Item1, Item2, Item3, Item4
polygon = Polygon(Plane=PlaneXY(0, 0, 0), Radius=measurements.Item, Segments=measurements.Item1, FilletRadius=0)  # -> Polygon, Length
unit_z = UnitZ(Factor=measurements.Item4)
rotate = Rotate(Geometry=polygon.Polygon, Angle=measurements.Item2, Plane=PlaneXY(0, 0, 0))  # -> Geometry, Transform
series = Series(Start=0, Step=1, Count=measurements.Item3)
extrude = Extrude(Base=rotate.Geometry, Direction=unit_z)
unit_x = UnitX(Factor=series)
move = Move(Geometry=extrude, Motion=unit_x)  # -> Geometry, Transform
