# Grasshopper definition nightlamp.gh (Grasshopper 1.0.7)
# plug-ins: Firefly.Core

select_serial_port = Slider(4, range=3..5)
open_port = BooleanToggle(False)
baud_rate = Panel("9600")
trigger = Trigger(Interval=20, TimerInterval=20, Target=serial_read_generic)
serial_read_generic = SerialReadGeneric(StartReadingValues=open_port, PortNumber=select_serial_port)  # -> SerialOutput, StatusMessage
open_close_port = OpenClosePort(OpenClosePort=open_port, PortNumber=select_serial_port, BaudRate=baud_rate)

offset_naar_binnen = Slider(14, range=0..20)
countour_lampsegment = Curve(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)
neg = Negative(Value=offset_naar_binnen)
offset = OffsetCurve(Curve=countour_lampsegment, Distance=neg, Corners=1)

# ---- group: Orientatie Streepje
vec = VectorXYZ(XComponent=Slider(6, range=0..10), YComponent=Slider(6, range=0..10), ZComponent=0)  # -> Vector, Length

# ----
raw_serial_read = Panel(serial_read_generic.SerialOutput)
status_connection = Panel(open_close_port)
seperator = Panel("|")
lengte_streepje = Slider(5, range=2..10)
text_split = TextSplit(Text=raw_serial_read, Separators=seperator)
aantal_punten = Slider(41, range=20..100)
panel = Panel("0,0,0")
panel_2 = Panel(text_split)
pop2d = Populate2D(Region=offset, Count=aantal_punten, Seed=1)
cirkel_radius = Slider(3, range=1..10)
measurements = ListItem(List=panel_2, Index=0, Wrap=True)  # -> Item, Item1, Item2, Item3, Item4
rectangle = Rectangle(Plane=pop2d, XSize=Domain(-1, 1), YSize=Domain(-2, 2), Radius=0)  # -> Rectangle, Length
line = LineSDL(Start=pop2d, Direction=vec.Vector, Length=lengte_streepje)
cir = Circle(Plane=pop2d, Radius=cirkel_radius)
# GATE vervangen door een actuator die 0/1/2 kan leveren als waarde?
number_slider = Slider(2, range=0..2)
rechthoek = Curve(rectangle.Rectangle)
streepje = Curve(line)
cirkel = Curve(cir)
polygon = Polygon(Plane=PlaneXY(0, 0, 0), Radius=measurements.Item, Segments=measurements.Item1, FilletRadius=0)  # -> Polygon, Length
filter = StreamFilter(Gate=number_slider, Stream0=streepje, Stream1=rechthoek, Stream2=cirkel)
rotate = Rotate(Geometry=polygon.Polygon, Angle=measurements.Item2, Plane=PlaneXY(0, 0, 0))  # -> Geometry, Transform
unit_z = UnitZ(Factor=measurements.Item4)
series = Series(Start=0, Step=1, Count=measurements.Item3)
extrude = Extrude(Base=rotate.Geometry, Direction=unit_z)
unit_x = UnitX(Factor=series)
move = Move(Geometry=extrude, Motion=unit_x)  # -> Geometry, Transform
